# Dynamo graph DataToExcel.dyn (Dynamo 2.19.3.6394)

# group: Get elements by category
categories = Categories("OST_MechanicalEquipment")
current = Document.Current()
activeView = Document.ActiveView(document=current)
all_elements_of_category_in_view = ElementsOfCategoryInView(Category=categories, View=activeView)

# group: Get Rooms
categories_2 = Categories("OST_Rooms")
all_elements_of_category = ElementsOfCategory(Category=categories_2)

# group: Check if elements are inside rooms
getLocation = Element.GetLocation(element=all_elements_of_category_in_view)
isInsideRoom = Room.IsInsideRoom(room=all_elements_of_category, point=getLocation@L1)
boolean = BoolSelector(true)
indexOf = List.IndexOf(list=isInsideRoom@L2, element=boolean)

# group: Data organization
elementType = Element.ElementType(element=all_elements_of_category_in_view)
string = StringInput("Level")
getParameterValueByName = Element.GetParameterValueByName(element=all_elements_of_category, parameterName=string)
getItemAtIndex = List.GetItemAtIndex(list=getParameterValueByName, index=indexOf)
string_2 = StringInput("Department")
getParameterValueByName_2 = Element.GetParameterValueByName(element=all_elements_of_category, parameterName=string_2)
getItemAtIndex_2 = List.GetItemAtIndex(list=getParameterValueByName_2, index=indexOf)
name = Room.Name(room=all_elements_of_category)
getItemAtIndex_3 = List.GetItemAtIndex(list=name, index=indexOf)
number = Room.Number(room=all_elements_of_category)
getItemAtIndex_4 = List.GetItemAtIndex(list=number, index=indexOf)
list_create = List.Create(item0=elementType, item1=getItemAtIndex, item2=getItemAtIndex_2, item3=getItemAtIndex_3, item4=getItemAtIndex_4)

# group: excel format output
directory_path = Directory("C:\Users\ychiang2\Desktop\20250513\ExyteHelloWorld\ExyteDynamo")  # frozen
code_block = CodeBlock(D=directory_path) { D + "/equ_room_data.xlsx"; }
code_block_2 = CodeBlock { "data1"; }
code_block_3 = CodeBlock { 0; }
transpose = List.Transpose(lists=list_create)
exportToExcel = Data.ExportToExcel(filePath=code_block, sheetName=code_block_2, startRow=code_block_3, startColumn=code_block_3, data=transpose)

# group: Get room solids
solids = Element.Solids(element=all_elements_of_category)
string_3 = StringInput("A")
allIndicesOf = List.AllIndicesOf(list=getParameterValueByName_2, item=string_3)
getItemAtIndex_5 = List.GetItemAtIndex(list=solids, index=allIndicesOf)
string_4 = StringInput("B")
allIndicesOf_2 = List.AllIndicesOf(list=getParameterValueByName_2, item=string_4)
getItemAtIndex_6 = List.GetItemAtIndex(list=solids, index=allIndicesOf_2)
string_5 = StringInput("C")
allIndicesOf_3 = List.AllIndicesOf(list=getParameterValueByName_2, item=string_5)
getItemAtIndex_7 = List.GetItemAtIndex(list=solids, index=allIndicesOf_3)
